# Grasshopper definition bricks.gh (Grasshopper 1.0.7)

# ---- group: Brick
length = Slider(7.625, range=0..10)
width = Slider(3.625, range=0..10)
height = Slider(2.25, range=0..10)
rectangle = Rectangle(Plane=PlaneXY(0, 0, 0), XSize=length, YSize=width, Radius=0)  # -> Rectangle, Length
boxrec = BoxRectangle(Rectangle=rectangle.Rectangle, Height=height)
